test file "AutonomousEmergencyBrakingTests"

suite "Test Scenarios"

  case "scenario_01_AEB_Bicyclist_Longitudinal_25width" [simulation]
    model AEBTestBench
    post-load callback:
      helperSLAEBSetup(scenarioFcnName= "scenario_01_AEB_Bicyclist_Longitudinal_25width");
    cleanup callback:
      helperPlotAEBResults(sltest_simout.logsout);

  case "scenario_02_AEB_Bicyclist_Longitudinal_50width" [simulation]
    model AEBTestBench
    post-load callback:
      helperSLAEBSetup(scenarioFcnName= "scenario_02_AEB_Bicyclist_Longitudinal_50width");
    cleanup callback:
      helperPlotAEBResults(sltest_simout.logsout);

  case "scenario_03_AEB_Bicyclist_Longitudinal_75width" [simulation]
    model AEBTestBench
    post-load callback:
      helperSLAEBSetup(scenarioFcnName= "scenario_03_AEB_Bicyclist_Longitudinal_75width");
    cleanup callback:
      helperPlotAEBResults(sltest_simout.logsout);

  case "scenario_04_AEB_CCRb_2_initialGap_12m" [simulation]
    model AEBTestBench
    post-load callback:
      helperSLAEBSetup(scenarioFcnName= "scenario_04_AEB_CCRb_2_initialGap_12m");
    cleanup callback:
      helperPlotAEBResults(sltest_simout.logsout);

  case "scenario_05_AEB_CCRb_2_initialGap_40m" [simulation]
    model AEBTestBench
    post-load callback:
      helperSLAEBSetup(scenarioFcnName= "scenario_05_AEB_CCRb_2_initialGap_40m");
    cleanup callback:
      helperPlotAEBResults(sltest_simout.logsout);

  case "scenario_06_AEB_CCRb_6_initialGap_12m" [simulation]
    model AEBTestBench
    post-load callback:
      helperSLAEBSetup(scenarioFcnName= "scenario_06_AEB_CCRb_6_initialGap_12m");
    cleanup callback:
      helperPlotAEBResults(sltest_simout.logsout);

  case "scenario_07_AEB_CCRb_6_initialGap_40m" [simulation]
    model AEBTestBench
    post-load callback:
      helperSLAEBSetup(scenarioFcnName= "scenario_07_AEB_CCRb_6_initialGap_40m");
    cleanup callback:
      helperPlotAEBResults(sltest_simout.logsout);

  case "scenario_08_AEB_CCRm_50overlap" [simulation]
    model AEBTestBench
    post-load callback:
      helperSLAEBSetup(scenarioFcnName= "scenario_08_AEB_CCRm_50overlap");
    cleanup callback:
      helperPlotAEBResults(sltest_simout.logsout);

  case "scenario_09_AEB_CCRm__50overlap" [simulation]
    model AEBTestBench
    post-load callback:
      helperSLAEBSetup(scenarioFcnName= "scenario_09_AEB_CCRm__50overlap");
    cleanup callback:
      helperPlotAEBResults(sltest_simout.logsout);

  case "scenario_10_AEB_CCRm_75overlap" [simulation]
    model AEBTestBench
    post-load callback:
      helperSLAEBSetup(scenarioFcnName= "scenario_10_AEB_CCRm_75overlap");
    cleanup callback:
      helperPlotAEBResults(sltest_simout.logsout);

  case "scenario_11_AEB_CCRm__75overlap" [simulation]
    model AEBTestBench
    post-load callback:
      helperSLAEBSetup(scenarioFcnName= "scenario_11_AEB_CCRm__75overlap");
    cleanup callback:
      helperPlotAEBResults(sltest_simout.logsout);

  case "scenario_12_AEB_CCRm_100overlap" [simulation]
    model AEBTestBench
    post-load callback:
      helperSLAEBSetup(scenarioFcnName= "scenario_12_AEB_CCRm_100overlap");
    cleanup callback:
      helperPlotAEBResults(sltest_simout.logsout);

  case "scenario_13_AEB_CCRs_50overlap" [simulation]
    model AEBTestBench
    post-load callback:
      helperSLAEBSetup(scenarioFcnName= "scenario_13_AEB_CCRs_50overlap");
    cleanup callback:
      helperPlotAEBResults(sltest_simout.logsout);

  case "scenario_14_AEB_CCRs__50overlap" [simulation]
    model AEBTestBench
    post-load callback:
      helperSLAEBSetup(scenarioFcnName= "scenario_14_AEB_CCRs__50overlap");
    cleanup callback:
      helperPlotAEBResults(sltest_simout.logsout);

  case "scenario_15_AEB_CCRs_75overlap" [simulation]
    model AEBTestBench
    post-load callback:
      helperSLAEBSetup(scenarioFcnName= "scenario_15_AEB_CCRs_75overlap");
    cleanup callback:
      helperPlotAEBResults(sltest_simout.logsout);

  case "scenario_16_AEB_CCRs__75overlap" [simulation]
    model AEBTestBench
    post-load callback:
      helperSLAEBSetup(scenarioFcnName= "scenario_16_AEB_CCRs__75overlap");
    cleanup callback:
      helperPlotAEBResults(sltest_simout.logsout);

  case "scenario_17_AEB_CCRs_100overlap" [simulation]
    model AEBTestBench
    post-load callback:
      helperSLAEBSetup(scenarioFcnName= "scenario_17_AEB_CCRs_100overlap");
    cleanup callback:
      helperPlotAEBResults(sltest_simout.logsout);

  case "scenario_18_AEB_Pedestrian_Farside_50width" [simulation]
    model AEBTestBench
    post-load callback:
      helperSLAEBSetup(scenarioFcnName= "scenario_18_AEB_Pedestrian_Farside_50width");
    cleanup callback:
      helperPlotAEBResults(sltest_simout.logsout);

  case "scenario_19_AEB_Pedestrian_Longitudinal_25width" [simulation]
    model AEBTestBench
    post-load callback:
      helperSLAEBSetup(scenarioFcnName= "scenario_19_AEB_Pedestrian_Longitudinal_25width");
    cleanup callback:
      helperPlotAEBResults(sltest_simout.logsout);

  case "scenario_20_AEB_Pedestrian_Longitudinal_50width" [simulation]
    model AEBTestBench
    post-load callback:
      helperSLAEBSetup(scenarioFcnName= "scenario_20_AEB_Pedestrian_Longitudinal_50width");
    cleanup callback:
      helperPlotAEBResults(sltest_simout.logsout);

  case "scenario_21_AEB_Pedestrian_Nearside_25width" [simulation]
    model AEBTestBench
    post-load callback:
      helperSLAEBSetup(scenarioFcnName= "scenario_21_AEB_Pedestrian_Nearside_25width");
    cleanup callback:
      helperPlotAEBResults(sltest_simout.logsout);

  case "scenario_22_AEB_Pedestrian_Nearside_75width" [simulation]
    model AEBTestBench
    post-load callback:
      helperSLAEBSetup(scenarioFcnName= "scenario_22_AEB_Pedestrian_Nearside_75width");
    cleanup callback:
      helperPlotAEBResults(sltest_simout.logsout);

  case "scenario_23_AEB_PedestrianChild_Nearside_50width" [simulation]
    model AEBTestBench
    post-load callback:
      helperSLAEBSetup(scenarioFcnName= "scenario_23_AEB_PedestrianChild_Nearside_50width");
    cleanup callback:
      helperPlotAEBResults(sltest_simout.logsout);

  case "scenario_24_AEB_PedestrianTurning_Farside_10kph" [simulation]
    model AEBTestBench
    post-load callback:
      helperSLAEBSetup(scenarioFcnName= "scenario_24_AEB_PedestrianTurning_Farside_10kph");
    cleanup callback:
      helperPlotAEBResults(sltest_simout.logsout);

  case "scenario_25_AEB_PedestrianTurning_Nearside_10kph" [simulation]
    model AEBTestBench
    post-load callback:
      helperSLAEBSetup(scenarioFcnName= "scenario_25_AEB_PedestrianTurning_Nearside_10kph");
    cleanup callback:
      helperPlotAEBResults(sltest_simout.logsout);

  case "scenario_26_AEB_CCFtap_VUT_10kph_GVT_30kph" [simulation]
    model AEBTestBench
    post-load callback:
      helperSLAEBSetup(scenarioFcnName= "scenario_26_AEB_CCFtap_VUT_10kph_GVT_30kph");
    cleanup callback:
      helperPlotAEBResults(sltest_simout.logsout);